# Grasshopper definition Sand-Design-Master-Template-RH8.gh (Grasshopper 1.0.8)
# plug-ins: RhinoCodePluginGH

# ---- group: Robot
reload = Button()
robot_model = ValueList({"UR10e": "ur10e", "UR10": "ur10"}, selected="UR10e")
robot_working_area = Curve(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)
robot_working_volume = Brep(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)
list = ValueList({"Joint", "Linear"}, selected="Linear")
ur10e = IronPython2Script(R=reload, U=robot_model)  # -> M
# ---------- ur10e: IronPython ----------
import os

import compas_fab

from compas_robots import RobotModel
from compas_robots.resources import LocalPackageMeshLoader

canvas = ghenv.Component.OnPingDocument()
current_folder = os.path.join(os.path.dirname(canvas.FilePath))

# Locate the URDF file in the same folder
urdf_file = os.path.join(current_folder, "..", "..", "__robot-files", U + ".urdf")

# Create robot model from URDF
model = RobotModel.from_urdf_file(urdf_file)


# Also load geometry
loader = LocalPackageMeshLoader(os.path.join(current_folder, "..", "..", "__robot-files", "universal_robot"), "ur_description")
model.load_geometry(loader, precision=12)

M = model
# ---------- end ur10e ----------
solver = IronPython2Script(M=ur10e, S=robot_model)  # -> R
# ---------- solver: IronPython ----------
import os

import compas_fab
from compas.scene import Scene
from compas_fab.backends import AnalyticalInverseKinematics
from compas_fab.backends.interfaces import ClientInterface
from compas_fab.robots import Robot
from compas_fab.robots import RobotSemantics

canvas = ghenv.Component.OnPingDocument()
current_folder = os.path.join(os.path.dirname(canvas.FilePath))

# Locate the SRDF file in the current folder
srdf_file = os.path.join(current_folder, "..", "..", "__robot-files", 'ur10e.srdf')
semantics = RobotSemantics.from_srdf_file(srdf_file, M)

# Create an IK solver
client = ClientInterface()
client.is_connected = True
client.inverse_kinematics = AnalyticalInverseKinematics(solver=S)

# Create scene object
scene = Scene()
scene_object = scene.add(M)

R = Robot(M, scene_object, client=client, semantics=semantics)
# ---------- end solver ----------

# ---- group: Global parameters
speed_0_to_80_mm_s_max = Panel("90")
zone_blend_radius_mm = Panel("10")
# Parameter Exploration
acceleration_mm_s = Panel("50")

# ---- group: toolhead
pt = Point(Point(0.09420441032, -7.584409795e-05, -0.2279541738))
end_effector = Panel("sand_valve")
mesh = Mesh(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)
tcp = ConstructPlane(Origin=pt, XAxis=Vector(1, 0, 0), YAxis=Vector(0, 1, 0))
weight_kg = Panel("0.2")
attach_tool = IronPython2Script(robot=solver, visual_mesh=mesh, tcf_plane=tcp, connected_to="flange")  # -> robot; inputs visual_mesh: Mesh
# ---------- attach_tool: IronPython ----------
"""
Attach a tool to the robot.

COMPAS FAB v1.0.1
"""

from compas.geometry import Frame
from compas_rhino.conversions import mesh_to_compas
from compas_rhino.conversions import plane_to_compas_frame
from ghpythonlib.componentbase import executingcomponent as component

from compas_fab.robots import Tool


class AttachToolComponent(component):
    def RunScript(self,
            robot,
            visual_mesh,
            collision_mesh,
            tcf_plane,
            group,
            connected_to):
        if robot and robot.client and robot.client.is_connected and visual_mesh:
            if not collision_mesh:
                collision_mesh = visual_mesh

            c_visual_mesh = mesh_to_compas(visual_mesh)
            c_collision_mesh = mesh_to_compas(collision_mesh)

            if not tcf_plane:
                frame = Frame.worldXY()
            else:
                frame = plane_to_compas_frame(tcf_plane)
            tool = Tool(c_visual_mesh, frame, c_collision_mesh, connected_to=connected_to)

            robot.attach_tool(tool, group)

        return robot
# ---------- end attach_tool ----------

# ---- group: Robot configuration
robot_configuration_type = ValueList({"0", "1", "2", "3", "4", "5", "6", "7"}, selected="0")

# ---- group: Robotic setup
# UR10 Settings
# Do not edit components
# in black groups
sand_box_and_table = Brep([<brep referenced from the Rhino model> x319])
offset = Curve(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)
preview = CustomPreview(Geometry=sand_box_and_table, Material=ColourSwatch(SwatchColor=RGBA(222, 222, 222, 114)))

# ----
wating_time_s = Slider(2, range=0..10000)
# Home Position
reference_point = Point(Point(0.651073194, 0.01404171417, 0.6266659301))
tcp_2 = ConstructPlane(Origin=reference_point, XAxis=Vector(1, 0, 0), YAxis=Vector(0, 1, 0))
inverse_kinematics = IronPython2Script(
    R=attach_tool,
    P=tcp_2,
    CT=robot_configuration_type,
    S=speed_0_to_80_mm_s_max,
    A=acceleration_mm_s,
    B=zone_blend_radius_mm)  # -> C
# ---------- inverse_kinematics: IronPython ----------
"""
Calculate the robot's inverse kinematic for a given plane.

COMPAS FAB v1.0.1
"""
import math
from compas_rhino.conversions import plane_to_compas_frame
from ghpythonlib.componentbase import executingcomponent as component


class InverseKinematics(component):
    def RunScript(self, R, P, M, CT, S, A, B):
        robot = R
        plane = P
        motion_type = M or "Linear"
        config_type = CT
        speed = S
        accel = A
        blend = B
        configuration = None
        
        if motion_type not in ("Joint", "Linear"):
            raise ValueError("Invalid motion type selected")

        if robot and robot.client and robot.client.is_connected and plane:
            frame = plane_to_compas_frame(plane)

            configs = robot.iter_inverse_kinematics(frame, start_configuration=None, options={'keep_order': True})
            configuration = list(configs)[config_type]
            configuration.motion_type = motion_type
            configuration.speed = float(speed) / 1000.
            configuration.accel = float(accel) / 1000.
            configuration.blend = float(blend) / 1000.

            if configuration["shoulder_pan_joint"] > math.pi:
                configuration["shoulder_pan_joint"] -= math.pi * 2
                
            if configuration["wrist_1_joint"] > math.pi:
                configuration["wrist_1_joint"] = (math.pi * 2 - configuration["wrist_1_joint"]) * -1
                

            # Fix ARM Flip!
            configuration["shoulder_pan_joint"] += math.pi
            configuration["shoulder_lift_joint"] -= math.pi * 2

#            elif configuration["shoulder_pan_joint"] < math.pi:
#                configuration["shoulder_pan_joint"] += math.pi * 2

        return configuration
# ---------- end inverse_kinematics ----------
wait = IronPython2Script(T=wating_time_s)  # -> C
# ---------- wait: IronPython ----------
class WaitCommand(object):
    def __init__(self, wait_time):
        self.wait_time = wait_time
    def ToString(self):
        return "Wait({} seconds)".format(self.wait_time)
    def command(self):
        return "wait"
    def to_command_data(self):
        return {"command": self.command(), "wait_time": self.wait_time}

C = WaitCommand(T)
# ---------- end wait ----------

# ---- group: I/O Continuous Print
value = Panel("1")
do_num = Panel("0")
value_2 = Panel("0")
set_io = GhPythonScript(S=do_num, V=value)  # -> C; same code as set_io
set_io_2 = GhPythonScript(S=do_num, V=value_2)  # -> C; same code as set_io

# ----
crv = Curve(<curve referenced from the Rhino model>)
crv_2 = Curve(<curve referenced from the Rhino model>)
divide = DivideCurve(Curve=crv, Count="5", Kinks=False)  # -> Points, Tangents, Parameters
divide_2 = DivideCurve(Curve=crv_2, Count="5", Kinks=False)  # -> Points, Tangents, Parameters
pl = ConstructPlane(Origin=divide.Points, XAxis=Vector(1, 0, 0), YAxis=divide.Tangents)
pl_2 = ConstructPlane(Origin=divide_2.Points, XAxis=Vector(1, 0, 0), YAxis=divide_2.Tangents)
weave = Weave(Pattern=[0, 1], Stream0=pl_2, Stream1=pl, NullGaps=False)

pt_2 = Point(<point referenced from the Rhino model>)
circle = CircleCNR(Center=pt_2, Normal=Vector(0, 0, 1), Radius=Slider(0.14, range=0..1))
pframes = PerpFrames(Curve=circle, Count=10, Align=True)  # -> Frames, Parameters
deplane = DeconstructPlane(Plane=pframes.Frames)  # -> Origin, XAxis, YAxis, ZAxis
pl_3 = ConstructPlane(Origin=deplane.Origin, XAxis=deplane.XAxis, YAxis=deplane.ZAxis)

crv_3 = Curve(<curve referenced from the Rhino model>)
X = UnitX(Factor=Slider(0.1, range=0..0.1))
arrlinear = LinearArray(Geometry=crv_3, Direction=X, Count="3")  # -> Geometry, Transform

pt_3 = Point(Point(0.5278320501, -0.1983574384, 0.15))
pt_4 = Point(Point(0.3892888862, 0.1888231739, 0.15))
ln = Line(StartPoint=pt_3, EndPoint=pt_4)
pl_4 = PlaneNormal(Origin=[pt_3, pt_4], ZAxis=Vector(0, 0, 1))

crv_4 = Curve(<curve referenced from the Rhino model>)
pframes_2 = PerpFrames(Curve=crv_4, Count=Slider(20, range=0..100), Align=True)  # -> Frames, Parameters
deplane_2 = DeconstructPlane(Plane=pframes_2.Frames)  # -> Origin, XAxis, YAxis, ZAxis
pl_5 = ConstructPlane(Origin=deplane_2.Origin, XAxis=deplane_2.XAxis, YAxis=deplane_2.ZAxis)

pframes_3 = PerpFrames(Curve=arrlinear.Geometry, Count=10, Align=True)  # -> Frames, Parameters
deplane_3 = DeconstructPlane(Plane=pframes_3.Frames)  # -> Origin, XAxis, YAxis, ZAxis
pl_6 = ConstructPlane(Origin=deplane_3.Origin, XAxis=deplane_3.XAxis, YAxis=deplane_3.ZAxis)

# ----
# Speed
pt_5 = Point(Point(0.5199696654, 0.2621618718, 0.3843155639))
Y = UnitY(Factor=Slider(0.5, range=0..0.5))
neg = Negative(Value=Y)
move = Move(Geometry=pt_5, Motion=neg)  # -> Geometry, Transform
ln_2 = Line(StartPoint=pt_5, EndPoint=move.Geometry)
divide_3 = DivideCurve(Curve=ln_2, Count=Slider(5, range=0..10), Kinks=False)  # -> Points, Tangents, Parameters
pt_6 = Point(divide_3.Points)

# ----
# IO (Input / Output)
pt_7 = Point(Point(0.5199696654, 0.2621618718, 0.3843155639))
Y_2 = UnitY(Factor=Slider(0.5, range=0..0.5))
neg_2 = Negative(Value=Y_2)
move_2 = Move(Geometry=pt_7, Motion=neg_2)  # -> Geometry, Transform
ln_3 = Line(StartPoint=pt_7, EndPoint=move_2.Geometry)
divide_4 = DivideCurve(Curve=ln_3, Count=Slider(5, range=0..10), Kinks=False)  # -> Points, Tangents, Parameters
pt_8 = Point(divide_4.Points)

# ---- group: Incremental speed
max_speed_mm_s = Panel("80")
min_speed_mm_s = Panel("10")
lng = ListLength(List=pt_6)
dom = ConstructDomain(DomainStart=min_speed_mm_s, DomainEnd=max_speed_mm_s)
range = Range(Domain=dom, Steps=expr("x-1", lng))

# ---- group: Planes
pl_7 = ConstructPlane(Origin=pt_8, XAxis=Vector(1, 0, 0), YAxis=Vector(0, 1, 0))

pl_8 = ConstructPlane(Origin=pt_6, XAxis=Vector(1, 0, 0), YAxis=Vector(0, 1, 0))

# ----
# Combining
# Instructions
merge = Merge(Data1=pl_4, Data2=pl_5, Data3=pl_6, Data4=weave)  # -> flatten(Result)

inverse_kinematics_2 = IronPython2Script(
    R=attach_tool,
    P=pl_7,
    CT=robot_configuration_type,
    S=speed_0_to_80_mm_s_max,
    A=acceleration_mm_s,
    B=zone_blend_radius_mm)  # -> C; same code as inverse_kinematics

ins = InsertItems(List=inverse_kinematics_2, Item=set_io, Indices="1", Wrap=True)
entwine = Entwine(Branch00=ins, Branch01=set_io_2, FlattenInputs=True)  # -> flatten(Result)

# ----
# Positional Instructions
# Linear Movement
# Curved Movement
# Lists of Movements
# Interveaving Movemnts
# Radial Movement
inverse_kinematics_3 = IronPython2Script(
    R=attach_tool,
    P=merge,
    CT=robot_configuration_type,
    S=speed_0_to_80_mm_s_max,
    A=acceleration_mm_s,
    B=zone_blend_radius_mm)  # -> C
# ---------- inverse_kinematics_3: IronPython ----------
"""
Calculate the robot's inverse kinematic for a given plane.

COMPAS FAB v1.0.1
"""
import math
from compas_rhino.conversions import plane_to_compas_frame
from ghpythonlib.componentbase import executingcomponent as component


class InverseKinematics(component):
    def RunScript(self, R, P, M, CT, S, A, B):
        robot = R
        plane = P
        motion_type = M or "Linear"
        config_type = CT
        speed = S
        accel = A
        blend = B
        configuration = None
        
        if motion_type not in ("Joint", "Linear"):
            raise ValueError("Invalid motion type selected")

        if robot and robot.client and robot.client.is_connected and plane:
            frame = plane_to_compas_frame(plane)

            configs = robot.iter_inverse_kinematics(frame, start_configuration=None, options={'keep_order': True})
            configuration = list(configs)[config_type]
            configuration.motion_type = motion_type
            configuration.speed = float(speed) / 1000.
            configuration.accel = float(accel) / 1000.
            configuration.blend = float(blend) / 1000.

            if configuration["shoulder_pan_joint"] > math.pi:
                configuration["shoulder_pan_joint"] -= math.pi * 2

            # Fix ARM Flip!
            configuration["shoulder_pan_joint"] += math.pi
            configuration["shoulder_lift_joint"] -= math.pi * 2

#            elif configuration["shoulder_pan_joint"] < math.pi:
#                configuration["shoulder_pan_joint"] += math.pi * 2

        return configuration
# ---------- end inverse_kinematics_3 ----------

inverse_kinematics_4 = IronPython2Script(R=attach_tool, P=pl_8, CT=robot_configuration_type, S=range, A=acceleration_mm_s, B=zone_blend_radius_mm)  # -> C; same code as inverse_kinematics

# ---- group: Continuous Deposition
do_num_2 = Panel("0")
cluster = Cluster(L=inverse_kinematics_4, S=do_num_2)

# ---- group: Targets to plug
targets = Data(inverse_kinematics_3)

# ---- group: Continuous Deposition
do_num_3 = Panel("0")
cluster_2 = Cluster(L=entwine, S=do_num_3)

# ---- group: Targets to plug
targets_2 = Data(cluster)

targets_3 = Data(cluster_2)

# ----
# Collect Instructions
# By default you want to start and end with the
# home position. Therefore, you plug your
# instructions to the 0;1 input above.
entwine_2 = Entwine(Branch00=[inverse_kinematics, wait], Branch01=targets_2, Branch02=wait, FlattenInputs=True)  # -> flatten(Result)
filter = IronPython2Script(P=entwine_2)  # -> C, D; inputs P: list
# ---------- filter: IronPython ----------
from compas_robots import Configuration

program = P

configs = []
for i in program:
    if isinstance(i, Configuration):
        configs.append(i)
        
C = configs

D = "0 To {}".format(len(C) - 1)
# ---------- end filter ----------

# ----
# Realtime-preview
toggle = BooleanToggle(True)
trigger = Trigger(Interval=200, TimerInterval=200, Target=ipy2)  # disabled
ipy2 = IronPython2Script(Run=toggle)  # -> out, a
# ---------- ipy2: IronPython ----------
import time

# Check if the system is running based on the Trigger input
if Run:  # 'Run' is connected to your Trigger component output
    if 'toggle_state' not in globals():  # Initialize the state
        toggle_state = False

    # Toggle the output signal to True for a brief moment
    if toggle_state is False:
        a = True
        toggle_state = True
    else:
        a = False
        toggle_state = False

else:
    a = False  # If not running, output stays False
# ---------- end ipy2 ----------

# ---- group: 2. Set file name
group_xx = Panel("Group_XX")
day_0x = Panel("Day-01")

# ----
send_commands = Button()
ip = Panel("192.168.10.1")
ironpython_2_script = IronPython2Script(ip=ip, commands=entwine_2, send=send_commands)  # -> out, a; inputs commands: list
# ---------- ironpython_2_script: IronPython ----------
from __future__ import print_function

import copy
import os
import math

from compas.rpc import Proxy
from compas.data import json_dumps
from compas_robots import Configuration

new_commands = []

for cmd in commands:
    nc = {}
    if isinstance(cmd, Configuration):
        nc["command"] = "configuration"
        nc["configuration"] = cmd
        nc["speed"] = cmd.speed
        nc["accel"] = cmd.accel
        nc["motion_type"] = cmd.motion_type
        nc["blend"] = cmd.blend
    elif hasattr(cmd, "to_command_data"):
        nc = cmd.to_command_data()
    new_commands.append(nc)

    # Copy for pretty printing reasons only
    ncc = copy.copy(nc)
    command_type = ncc.pop("command")
    print("* Command: {}\n  Data: {}".format(command_type, ncc))


#
#def group_commands(commands):
#    grouped_commands = []
#    current_path = []
#
#    for cmd in commands:
#        if cmd["command"] == "configuration":
#            current_path.append(cmd)
#        else:
#            if current_path:
#                grouped_commands.append(current_path)
#                current_path = []
#            grouped_commands.append(cmd)
#
#    if current_path:
#        grouped_commands.append(current_path)
#
#    return grouped_commands
#
#gs = group_commands(new_commands)
#for g in gs:
#    print("Group!")
#    print(g)
#

print 
if send:
    if not commands:
        ghenv.Component.Message = "No commands to send"
    else:
        canvas = ghenv.Component.OnPingDocument()
        path = os.path.abspath(os.path.dirname(canvas.FilePath))
        rtde = Proxy('fabrication', path=path)
        a = rtde.send_commands(new_commands, ip=ip)
        ghenv.Component.Message = "Sent!"
# ---------- end ironpython_2_script ----------

current_config = IronPython2Script(ip=ip, send=Button())  # -> config
# ---------- current_config: IronPython ----------
from __future__ import print_function

import os
from scriptcontext import sticky as st
from compas.rpc import Proxy

config_key = 'config_{}'.format(str(ghenv.Component.InstanceGuid))

if config_key not in st:
    st[config_key] = None

if send:
    canvas = ghenv.Component.OnPingDocument()
    path = os.path.abspath(os.path.dirname(canvas.FilePath))
    rtde = Proxy('fabrication', path=path)
    ghenv.Component.Message = "Config received!"
    st[config_key] = rtde.get_config(ip=ip)



config = st[config_key]
# ---------- end current_config ----------
config = IronPython2Script(C=current_config)  # -> out
# ---------- config: IronPython ----------
from __future__ import print_function
import math

if C:
    for name in C.joint_names:
        print("{:<20}: {:.2f}".format(name, math.degrees(C[name])))
# ---------- end config ----------
panel = Panel(config)

percent = Slider(9, range=0..100)
remap = RemapNumbers(Value=percent, Source="0 To 100", Target=filter.D)  # -> Mapped, Clipped
item = ListItem(List=filter.C, Index=remap.Mapped, Wrap=True)
compas_fab_robot_visualize = IronPython2Script(robot=attach_tool, configuration=item, show_frames=True, show_end_effector_frame=True)  # -> visual, collision, collision_meshes, attached_meshes, frames, base_frame, ee_frame; inputs show_visual: Boolean, show_collision: Boolean, show_frames: Boolean, show_base_frame: Boolean, show_end_effector_frame: Boolean, show_cm: Boolean, show_acm: Boolean
# ---------- compas_fab_robot_visualize: IronPython ----------
"""
Visualizes the robot.

COMPAS FAB v1.0.1
"""

import System
import time

from compas.geometry import Frame
from compas.geometry import Transformation
from compas.scene import SceneObject
from compas_ghpython import create_id
from compas_rhino.conversions import frame_to_rhino_plane
from ghpythonlib.componentbase import executingcomponent as component
from scriptcontext import sticky as st

from compas_fab.backends import BackendFeatureNotSupportedError
from compas_fab.robots import PlanningScene


class RobotVisualize(component):

    @property
    def InstanceGuid(self):
        if not hasattr(self, "instance_guid"):
            self.instance_guid = System.Guid.NewGuid()
        return self.instance_guid

    def RunScript(self,
            robot,
            group,
            configuration,
            show_visual,
            show_collision,
            show_frames,
            show_base_frame,
            show_end_effector_frame,
            show_cm,
            show_acm):
        visual = None
        collision = None
        collision_meshes = None
        attached_meshes = None
        frames = None
        base_frame = None
        ee_frame = None

        if robot:
            show_visual = True if show_visual is None else show_visual
            show_cm = True if show_cm is None else show_cm
            show_acm = True if show_acm is None else show_acm
            configuration = configuration or robot.zero_configuration()

            robot.update(configuration, visual=show_visual, collision=show_collision)
            compas_frames = robot.transformed_frames(configuration, group)

            if show_visual:
                visual = robot.scene_object.draw_visual()

            if show_collision:
                collision = robot.scene_object.draw_collision()

            if show_base_frame:
                base_compas_frame = compas_frames[0]
                base_frame = frame_to_rhino_plane(base_compas_frame)

            if show_end_effector_frame:
                options = dict(solver="model")
                if robot.attached_tool:
                    options["link"] = robot.attached_tool.connected_to

                ee_compas_frame = robot.forward_kinematics(configuration, group, options=options)
                ee_frame = frame_to_rhino_plane(ee_compas_frame)

            if show_frames:
                frames = []
                for compas_frame in compas_frames[1:]:
                    frame = frame_to_rhino_plane(compas_frame)
                    frames.append(frame)

            cached_scene_key = create_id(self, "cached_scene")

            if show_cm or show_acm:
                cached_scene = st.get(cached_scene_key)
                if not cached_scene:
                    cached_scene = {"time": 0}

                # expire cache if the component has not been executed in the last 2 seconds
                # this allows to slide through a list of configurations
                # without triggering refreshes of the scene in the middle of it
                if time.time() - cached_scene["time"] > 2:
                    update_scene = True
                else:
                    update_scene = False

                if update_scene:
                    scene = PlanningScene(robot)
                    try:
                        scene = robot.client.get_planning_scene()
                    except BackendFeatureNotSupportedError:
                        print("The selected backend does not support displaying collision meshes. Feature disabled")
                        scene = None
                        show_cm = False
                        show_acm = False

                if update_scene and show_cm:
                    collision_meshes = []

                    for co in scene.world.collision_objects:
                        header = co.header
                        frame_id = header.frame_id
                        cms = co.to_collision_meshes()

                        for cm in cms:
                            if cm.frame != Frame.worldXY():
                                t = Transformation.from_frame(cm.frame)
                                mesh = cm.mesh.transformed(t)
                            else:
                                mesh = cm.mesh

                            collision_meshes.extend(SceneObject(mesh).draw())

                        cached_scene["cm"] = collision_meshes

                collision_meshes = cached_scene.get("cm", [])

                if update_scene and show_acm:
                    attached_meshes = []

                    for aco in scene.robot_state.attached_collision_objects:
                        for acm in aco.to_attached_collision_meshes():
                            frame_id = aco.object["header"]["frame_id"]
                            frame = robot.forward_kinematics(configuration, options=dict(link=frame_id))
                            t = Transformation.from_frame(frame)

                            # Local CM frame
                            if acm.collision_mesh.frame and acm.collision_mesh.frame != Frame.worldXY():
                                t = t * Transformation.from_frame(acm.collision_mesh.frame)

                            mesh = acm.collision_mesh.mesh.transformed(t)

                            attached_meshes.extend(SceneObject(mesh).draw())

                    cached_scene["acm"] = attached_meshes

                attached_meshes = cached_scene.get("acm", [])

                cached_scene["time"] = time.time()
                st[cached_scene_key] = cached_scene

        return (
            visual,
            collision,
            collision_meshes,
            attached_meshes,
            frames,
            base_frame,
            ee_frame,
        )
# ---------- end compas_fab_robot_visualize ----------

# ----
# Execution
robot_program = Panel(ironpython_2_script.out)
geo = Geometry(compas_fab_robot_visualize.ee_frame)

# ---- group: 4. Set display options
toggle_2 = BooleanToggle(False)
toggle_3 = BooleanToggle(False)

# ---- group: 5. Click button to save image
button = Button()

# ---- group: 3. Set image dimensions
height = Panel("2400")
width = Panel("3200")

# ---- group: 1. Select target directory
path = FilePath("/Users/wasserwerk84/Library/CloudStorage/GoogleDrive-lorinw@ethz.ch/Geteilte Ablagen/GKR_Teaching/Seminar_Week/Sand_Deposition/ADMIN/05_Files/03_Sand-Deposition_Template/03_Screenshots/")

# ----
# Documentation
python = GhPythonScript(
    path=path,
    name=group_xx,
    assignment_nr=day_0x,
    width=width,
    height=height,
    display_grid=toggle_2,
    display_grid_axes=toggle_3,
    save=button)  # -> out; inputs width: Int32, height: Int32
# ---------- python: Python ----------
import Rhino.Display as rd
import scriptcontext as sc
import System
import os

file_name = name + "_" + assignment_nr

def get_next_index(path):
    index = 1
    while os.path.exists(path + file_name + str(index) + ".png"):
        index += 1
    return index

def ViewCaptureToFile(path):
    view = sc.doc.Views.ActiveView
    if view:
        view_capture = rd.ViewCapture()
        view_capture.TransparentBackground = False
        view_capture.Width = view.ActiveViewport.Size.Width
        view_capture.Height = view.ActiveViewport.Size.Width
        view_capture.ScaleScreenItems = False
        view_capture.DrawAxes = True
        view_capture.DrawGrid = display_grid
        view_capture.DrawGridAxes = display_grid_axes
        size = System.Drawing.Size(view_capture.Width, view_capture.Height)
        size = System.Drawing.Size(width, height)
        
        settings = rd.ViewCaptureSettings(view, size, 72) # view, size, dpi
        settings.RasterMode = True
        settings.DrawGrid = display_grid
        settings.DrawAxis = display_grid_axes
        settings.DrawWallpaper = False
        index = get_next_index(path)
            
        filename = file_name + str(index)
        filename_with_extension = filename + ".png"
        bitmap = rd.ViewCapture.CaptureToBitmap(settings)
        fullpath = path + filename_with_extension
        bitmap.Save(fullpath)
        
        return filename_with_extension
        
        
if path is None:
    ghenv.Component.Message = "Please select a target directory first"
else:
    if save:
        path = ViewCaptureToFile(path)
        ghenv.Component.Message = "Saved image to " + path
# ---------- end python ----------

config_2 = IronPython2Script(C=item)  # -> out; same code as config
panel_2 = Panel(config_2)

# ----
# Tool Height
pt_9 = Point(Point(0.5199696654, 0.2621618718, 0.3843155639))
Y_3 = UnitY(Factor=Slider(0.5, range=0..0.5))
neg_3 = Negative(Value=Y_3)
move_3 = Move(Geometry=pt_9, Motion=neg_3)  # -> Geometry, Transform
ln_4 = Line(StartPoint=pt_9, EndPoint=move_3.Geometry)
divide_5 = DivideCurve(Curve=ln_4, Count=Slider(6, range=0..10), Kinks=False)  # -> Points, Tangents, Parameters

dispatch = Dispatch(List=divide_5.Points, DispatchPattern=[True, False])  # -> ListA, ListB
Z = UnitZ(Factor=Slider(-0.13, range=-0.5..0.5))
move_4 = Move(Geometry=dispatch.ListB, Motion=Z)  # -> Geometry, Transform
weave_2 = Weave(Pattern=[0, 1], Stream0=dispatch.ListA, Stream1=move_4.Geometry, NullGaps=False)

pt_10 = Point(weave_2)

# ---- group: Path Visualizer
pline = PolyLine(Vertices=weave_2, Closed=False)

# ---- group: Planes
pl_9 = ConstructPlane(Origin=pt_10, XAxis=Vector(1, 0, 0), YAxis=Vector(0, 1, 0))

# ----
inverse_kinematics_5 = IronPython2Script(
    R=attach_tool,
    P=pl_9,
    CT=robot_configuration_type,
    S=speed_0_to_80_mm_s_max,
    A=acceleration_mm_s,
    B=zone_blend_radius_mm)  # -> C; same code as inverse_kinematics

# ---- group: Continuous Deposition
do_num_4 = Panel("0")
cluster_3 = Cluster(L=inverse_kinematics_5, S=do_num_4)

# ---- group: Targets to plug
targets_4 = Data(cluster_3)

# ----
# Waiting Time
pt_11 = Point(Point(0.5199696654, 0.2621618718, 0.3843155639))
number_slider = Slider(4, range=0..10)
Y_4 = UnitY(Factor=Slider(0.5, range=0..0.5))
neg_4 = Negative(Value=Y_4)
move_5 = Move(Geometry=pt_11, Motion=neg_4)  # -> Geometry, Transform
ln_5 = Line(StartPoint=pt_11, EndPoint=move_5.Geometry)
divide_6 = DivideCurve(Curve=ln_5, Count=number_slider, Kinks=False)  # -> Points, Tangents, Parameters
pt_12 = Point(divide_6.Points)

# ---- group: Waiting time
series = Series(Start=".5", Step=".5", Count=number_slider)
wait_2 = GhPythonScript(T=series)  # -> C; same code as wait
panel_3 = Panel(wait_2)

# ---- group: Planes
pl_10 = ConstructPlane(Origin=pt_12, XAxis=Vector(1, 0, 0), YAxis=Vector(0, 1, 0))

# ----
inverse_kinematics_6 = IronPython2Script(
    R=attach_tool,
    P=pl_10,
    CT=robot_configuration_type,
    S=speed_0_to_80_mm_s_max,
    A=acceleration_mm_s,
    B=zone_blend_radius_mm)  # -> C; same code as inverse_kinematics

weave_3 = Weave(Pattern=[0, 1], Stream0=inverse_kinematics_6, Stream1=wait_2, NullGaps=False)

# ---- group: Continuous Deposition
do_num_5 = Panel("0")
cluster_4 = Cluster(L=weave_3, S=do_num_5)

# ---- group: Targets to plug
targets_5 = Data(cluster_4)

# ==== cluster Cluster
L = ClusterInput()
S = ClusterInput()

# ---- group: I/O Continuous Print / I/O Settings
value = Panel("1")
do_num = Panel("0")
value_2 = Panel("0")

# ---- group: I/O Continuous Print
set_io = GhPythonScript(S=S, V=value)  # -> C
# ---------- set_io: Python ----------
class SetIOCommand(object):
    def __init__(self, signal, value):
        self.signal = int(signal)
        self.value = True if value == "1" else False

    def ToString(self):
        return "Set Digital IO (signal={}, value={})".format(self.signal, self.value)

    def command(self):
        return "set_digital_io"
        
    def to_command_data(self):
        return {"command": self.command(), "signal": self.signal, "value": self.value}

C = SetIOCommand(S, V)
# ---------- end set_io ----------
set_io_2 = GhPythonScript(S=S, V=value_2)  # -> C; same code as set_io
ins = InsertItems(List=L, Item=set_io, Indices="1", Wrap=True)
entwine = Entwine(Branch00=ins, Branch01=set_io_2, FlattenInputs=True)  # -> flatten(Result)

# ----
result = ClusterOutput(entwine)
